# Grasshopper definition REDUCE MESH.gh (Grasshopper 0.9.76)
# plug-ins: Kangaroo Components, Weaverbird, MeshDual, Starling

mesh = Mesh(<mesh referenced from the Rhino model>)
volume = Volume(Geometry=mesh)  # -> Volume, Centroid
scale = Scale(Geometry=mesh, Center=volume.Centroid, Factor=Slider(1.15, range=0..10))  # -> Geometry, Transform
demesh = DeconstructMesh(Mesh=scale.Geometry)  # -> Vertices, Faces, Colours, Normals
triangular_coverage = Slider(118.9, range=0..200)
diamond_coverage = Slider(62.3, range=0..214)
lng = ListLength(List=demesh.Vertices)
duppt = RemoveDuplicatePts(Points=demesh.Vertices, Tolerance=0.01)
reduce = RandomReduce(List=demesh.Vertices, Reduction=Slider(201900, range=0..220000), Seed=1)
lng_2 = ListLength(List=demesh.Vertices)
panel = Panel(lng_2)
duppt_2 = RemoveDuplicatePts(Points=reduce, Tolerance=0.01)
cp = ClosestPoint(Point=demesh.Vertices, Cloud=duppt_2)  # -> ClosestPoint, CPIndex, Distance
conmesh = ConstructMesh(Vertices=cp.ClosestPoint, Faces=demesh.Faces)
clean = CombineClean(Meshes=conmesh)
wbloop = WeaverbirdsLoopSubdivision(MeshCurves=clean, Level=1, SmoothNakedEdges=1)
meshdual = MeshDual(Mesh=wbloop, Center=Slider(3, range=0..10))
cp_2 = ControlPoints(Curve=meshdual)  # -> Points, Weights, Knots
facen = FaceNormals(Mesh=wbloop)  # -> Centers, Normals
multiplication = Multiplication(A=facen.Normals, B=0.1)
crv = Curve([<curve referenced from the Rhino model> x733])
vdis = VectorDisplay(Anchor=facen.Centers, Vector=multiplication)
len = Length(Curve=crv)  # -> simplify(Length)
larger = LargerThan(FirstNumber=len, SecondNumber=Slider(0.063, range=0..1))  # -> LargerThan, OrEqualTo
dispatch = Dispatch(List=crv, DispatchPattern=larger.LargerThan)  # -> ListA, ListB
larger_2 = LargerThan(FirstNumber=dispatch.ListA, SecondNumber=Slider(0.251, range=0..0.35))  # -> LargerThan, OrEqualTo
dispatch_2 = Dispatch(List=dispatch.ListA, DispatchPattern=larger_2.LargerThan)  # -> ListA, ListB
crv_2 = Curve(dispatch_2.ListA)
number_slider = Slider(0.01, range=0..1)
crv_3 = Curve(dispatch_2.ListB)
slstarmesh = SlStarMesh(Polyline=crv_3)
slstarmesh_2 = SlStarMesh(Polyline=crv_2)
clean_2 = CombineClean(Meshes=slstarmesh_2)
wbframe = WeaverbirdsPictureFrame(MeshPolylines=clean_2, Distance=Slider(2, range=0..10), InsetType=0)
clean_3 = CombineClean(Meshes=slstarmesh)
clean_4 = CombineClean(Meshes=flatten([slstarmesh, wbframe]))
wbthicken = WeaverbirdsMeshThicken(MeshCurves=wbframe, Distance=number_slider, OffsetType=0)
wbthicken_2 = WeaverbirdsMeshThicken(MeshCurves=clean_3, Distance=number_slider, OffsetType=0)
wbthicken_3 = WeaverbirdsMeshThicken(MeshCurves=clean_4, Distance=number_slider, OffsetType=0)
preview = CustomPreview(Geometry=wbthicken, Shader=ColourSwatch(SwatchColor=RGB(209, 137, 69)))
preview_2 = CustomPreview(Geometry=wbthicken_2, Shader=ColourSwatch(SwatchColor=RGB(240, 204, 86)))
